# Dynamo graph Emma Kierulff Dynamo ass 3B.dyn (Dynamo 3.2.1.5366)

family_types = FamilyTypes("CR:CR")
all_elements_of_family_type = ElementsOfFamilyType(Family_Type=family_types)
code_block = CodeBlock { "DFP"; 0.7; "TKFRAME"; 0.03; "DFPF"; 0.1; }
setParameterByName = Element.SetParameterByName(element=all_elements_of_family_type, parameterName=code_block.out0, value=code_block.out1)
setParameterByName_2 = Element.SetParameterByName(element=all_elements_of_family_type, parameterName=code_block.out2, value=code_block.out3)
setParameterByName_3 = Element.SetParameterByName(element=all_elements_of_family_type, parameterName=code_block.out4, value=code_block.out5)
code_block_2 = CodeBlock { "RNP"; }
count = List.Count(list=all_elements_of_family_type)
randomList = Math.RandomList(amount=count)
code_block_3 = CodeBlock { 0; 0.95; }
remapRange = Math.RemapRange(numbers=randomList, newMin=code_block_3.out0, newMax=code_block_3.out1)
code_block_4 = CodeBlock { 2; }
round = Math.Round(number=remapRange, digits=code_block_4)
setParameterByName_4 = Element.SetParameterByName(element=all_elements_of_family_type, parameterName=code_block_2, value=round)
